# Grasshopper definition Mycelium.gh (Grasshopper 1.0.7)
# plug-ins: Physarealm, Kangaroo2 Components, Bifocals, Shortest Walk in Gh, Fattener, Weaverbird

# ---- group: Base Geometry
unit_z = UnitZ(Factor=Slider(11, range=0..100))
base_curve = Curve(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)
rebuild_curve = RebuildCurve(Curve=base_curve, Count=Slider(14, range=0..100), Tangents=False)
move = Move(Geometry=rebuild_curve, Motion=unit_z)  # -> Geometry, Transform
loft = Loft(
    Curves=[rebuild_curve, move.Geometry],
    Options={Adjust=False, Closed=False, LoftEnds=0, LoftSimp=0, LoftType=0, Rebuild=10, Refit=0.01})
cap_holes = CapHoles(Brep=loft)

# ---- group: Base points
deconstruct_brep = DeconstructBrep(Brep=cap_holes)  # -> Faces, Edges, Vertices
list_item = ListItem(List=deconstruct_brep.Faces, Index=Slider(2, range=0..10), Wrap=True)
populate_geometry = PopulateGeometry(Geometry=list_item, Count=Slider(3, range=0..100), Seed=1)

# ----
area = Area(Geometry=list_item)  # -> Area, Centroid

# ---- group: Body Points
number_slider = Slider(4, range=0..10)
series = Series(Start=0, Step=Slider(2, range=0..10), Count=number_slider)
unit_z_2 = UnitZ(Factor=series)
series_2 = Series(Start=0, Step=Slider(26, range=0..100), Count=number_slider)
move_2 = Move(Geometry=list_item, Motion=unit_z_2)  # -> Geometry, Transform
rotate = Rotate(Geometry=move_2.Geometry, Angle=degrees(series_2), Plane=area.Centroid)  # -> Geometry, Transform
populate_geometry_2 = PopulateGeometry(Geometry=rotate.Geometry, Count=Slider(27, range=0..100), Seed=1)

# ---- group: Physrealm / Activate curves
button = Button()
trigger = Trigger(Interval=50, TimerInterval=50, Target=physarealm)  # disabled

# ---- group: Physrealm
number_slider_2 = Slider(31, range=0..100)
flatten_tree = FlattenTree(Tree=populate_geometry_2, Path="{0}")
point_emitter = PointEmitter(Points=populate_geometry)
brep_environment = BrepEnvironment(XResolution=number_slider_2, YResolution=number_slider_2, ZResolution=number_slider_2, Brep=cap_holes)
points_food = PointsFood(Points=flatten_tree)
physarealm = Physarealm(Environment=brep_environment, Emitter=point_emitter, Food=points_food, Reset=button)  # -> ChemoAttractorField, Population, Iteration
population_locations = PopulationLocations(Population=physarealm.Population)

# ---- group: Lines representation
proximity_3d = Proximity3D(Points=population_locations, Group=Slider(3, range=0..10))  # -> flatten(Links), Topology
average = Average(Input=population_locations)
line = Line(StartPoint=population_locations, EndPoint=average)
removeduplicatelines = RemoveDuplicateLines(Lines=proximity_3d.Links, Tolerance=0.01)
shortest_walk = ShortestWalk(Curves=removeduplicatelines, WantedPath=line)  # -> ShortestWalk, Succession, Direction, Length
join_curves = JoinCurves(Curves=shortest_walk.ShortestWalk, Preserve=False)
divide_curve = DivideCurve(Curve=join_curves, Count=Slider(20, range=0..100), Kinks=False)  # -> Points, Tangents, Parameters
polyline = PolyLine(Vertices=divide_curve.Points, Closed=False)

# ---- group: Mesh
flatten_tree_2 = FlattenTree(Tree=polyline, Path="{0}")
construct_domain = ConstructDomain(DomainStart=Slider(0.5, range=0..10), DomainEnd=Slider(0.01, range=0..10))
graft_tree = GraftTree(Tree=flatten_tree_2, IncludeEmptyLists=True, IncludeNullItems=True)
point = Point(Point(-8.513643938, 35.74958623, 0))
control_points = ControlPoints(Curve=graft_tree)  # -> Points, Weights, Knots
pull_point = PullPoint(Point=control_points.Points, Geometry=point, ClosestOnly=True)  # -> ClosestPoint, Distance
bounds = Bounds(Numbers=flatten(pull_point.Distance))
remap_numbers = RemapNumbers(Value=pull_point.Distance, Source=bounds, Target=construct_domain)  # -> Mapped, Clipped
sphere = Sphere(Base=control_points.Points, Radius=remap_numbers.Mapped)
fatten = Fatten(Skeleton=graft_tree, Spheres=sphere, Thickness=1, LengthSubdivisions=0, EndType=2, AdjustForAngle=False)
flatten_tree_3 = FlattenTree(Tree=fatten, Path="{0}")
weaverbird_s_catmull_clark_subdivision = WeaverbirdsCatmullClarkSubdivision(MeshCurves=flatten_tree_3, Level="2", SmoothNakedEdges=1)
custom_preview = CustomPreview(
    Geometry=weaverbird_s_catmull_clark_subdivision,
    Material={diffuse=RGB(221, 160, 221), emission=RGB(66, 48, 66), shine=0.5, specular=RGB(255, 255, 255), transparency=0})
